# Grasshopper definition M02_Measure_end_to_end.ghx (Grasshopper 1.0.8)

# ---- group: Load the CSV
# Start here!
# Right-click the “Path” node and select the CSV file.
path = FilePath("/Users/brianho/Developer/GitHub/intro-to-urban-data/Measure/example_data/saved_data.csv")
file = ReadFile(File=path, PerLineParse=True)
split = SplitList(List=file, Index="1")  # -> ListA, ListB
split_2 = TextSplit(Text=split.ListA, Separators=",")  # -> simplify(Result)
split_3 = TextSplit(Text=split.ListB, Separators=",")  # -> simplify(Result)

# ---- group: Get data from each column
item = ListItem(List=split_3, Index="2", Wrap=True)  # -> simplify(flatten(Item))
item_2 = ListItem(List=split_3, Index="1", Wrap=True)  # -> simplify(flatten(Item))
item_3 = ListItem(List=split_3, Index="3", Wrap=True)  # -> simplify(flatten(Item))

# ----
panel = Panel(split_2)

# ---- group: Create geometry
multiplication = Multiplication(A=item_3, B=Slider(25, range=0..100))
pt = ConstructPoint(XCoordinate=item, YCoordinate=item_2, ZCoordinate=0)
sph = Sphere(Base=pt, Radius=multiplication)
number_slider = Slider(1500, range=0..10000)
cyl = Cylinder(Base=pt, Radius=Slider(10, range=0..10), Length=number_slider)
Z = UnitZ(Factor=number_slider)
move = Move(Geometry=sph, Motion=Z)  # -> Geometry, Transform

# ---- group: Create a preview
preview = CustomPreview(Geometry=[cyl, move.Geometry], Material=ColourSwatch(SwatchColor=RGB(94, 252, 255)))
