# Grasshopper definition S02_Grasshopper.ghx (Grasshopper 1.0.7)

path = FilePath("/Users/brianho/Downloads/example (4).csv")
panel = Panel(path)
file = ReadFile(File=path, PerLineParse=True)
split = TextSplit(Text=file, Separators=";")  # -> simplify(Result)
flip = FlipMatrix(Data=split)

dom = ConstructDomain(DomainStart="4", DomainEnd="13")
subset = SubList(List=split, Domain=dom, Wrap=True)  # -> simplify(List), Index
series = Series(Start="1", Step=1, Count="4")
branch = TreeBranch(Tree=subset.List, Path=series, MaintainPaths=True)
split_2 = TextSplit(Text=branch, Separators=",")
rep = ReplaceText(Text=split_2, Find="(", RecursiveReplace=False)
rep_2 = ReplaceText(Text=rep, Find=")", RecursiveReplace=False)
rep_3 = ReplaceText(Text=rep_2, Find="[", RecursiveReplace=False)
rep_4 = ReplaceText(Text=rep_3, Find="]", RecursiveReplace=False)  # -> simplify(Result)

split_3 = SplitList(List=rep_4, Index="1")  # -> simplify(ListA), simplify(ListB)

split_4 = SplitList(List=flip, Index="1")  # -> simplify(flatten(ListA)), simplify(ListB)
series_2 = Series(Start="1", Step=1, Count="3")
branch_2 = TreeBranch(Tree=split_4.ListB, Path=series_2, MaintainPaths=True)
panel_2 = Panel(split_4.ListA)
bang = ExplodeTree(Data=branch_2)  # -> Branch0, Branch1, Branch2
pt = ConstructPoint(XCoordinate=bang.Branch2, YCoordinate=bang.Branch1, ZCoordinate=0)
rad = Radians(Degrees=bang.Branch0)

panel_3 = Panel("0")  # disabled

item = ListItem(List=split_3.ListB, Index="2", Wrap=True)
item_2 = ListItem(List=split_3.ListB, Index="0", Wrap=True)
item_3 = ListItem(List=split_3.ListB, Index="1", Wrap=True)
frgb = ColourRGBF(Alpha=1, Red=item_2, Green=item_3, Blue=item)
trim = TrimTree(Tree=frgb, Depth=1)

path_2 = FilePath("/Users/brianho/Developer/GitHub/intro-to-urban-data/Measure/Example Data/")  # disabled
branch_3 = TreeBranch(Tree=split_4.ListB, Path=panel_3, MaintainPaths=True)  # -> graft(Branch); disabled
panel_4 = Panel("0")  # disabled
number_slider = Slider(1000, range=0..1000)  # disabled
ins = InsertItems(List=branch_3, Item=path_2, Indices=panel_4, Wrap=True)  # disabled
join = TextJoin(Text=ins)  # -> simplify(Result); disabled
rectangle = Rectangle(Plane=pt, XSize=number_slider, YSize=number_slider, Radius=0)  # -> Rectangle, Length; disabled
img = ImportImage(File=flatten(join), Rectangle=rectangle.Rectangle)  # disabled

trim_2 = TrimTree(Tree=split_3.ListA, Depth=1)
ma = MassAddition(Input=trim_2)  # -> Result, PartialResults
Y = UnitY(Factor=ma.PartialResults)
pt_2 = Point(pt)
move = Move(Geometry=simplify(graft(pt_2)), Motion=Y)  # -> Geometry, Transform
split_5 = SplitList(List=move.Geometry, Index="9")  # -> simplify(ListA), ListB
ins_2 = InsertItems(List=split_5.ListA, Item=simplify(graft(pt_2)), Indices="0", Wrap=True)  # -> simplify(List)

panel_5 = Panel(join)  # disabled

rectangle_2 = Rectangle(Plane=ins_2, XSize=Slider(307, range=0..1000), YSize=trim_2, Radius=0)  # -> Rectangle, Length
rotate = Rotate(Geometry=rectangle_2.Rectangle, Angle=simplify(graft(rad)), Plane=simplify(graft(pt)))  # -> Geometry, Transform
mesh = Mesh(rotate.Geometry)
preview = CustomPreview(Geometry=mesh, Material=trim)
