# Grasshopper definition S02_Welcome_to_Grasshopper.ghx (Grasshopper 1.0.7)

path = FilePath("/Users/brianho/Developer/GitHub/intro-to-urban-data/Scale/example.csv")
# To start, update the path component to point to the CSV
# 
# You can do this by right-clicking on the path
# component, and choosing “Select one existing file”.
# 
# This group reads the CSV line-by-line, transforming
# each line into its own branch on a tree. Each line of
# the CSV is one photo.
# 
# We then flip the tree, so that the branches are the
# columns and the rows become lis items. This make
# it easierr to split out the columns we need for distinct
# purposes.
panel = Panel(path)
file = ReadFile(File=path, PerLineParse=True)
split = TextSplit(Text=file, Separators=";")  # -> simplify(Result)
flip = FlipMatrix(Data=split)

# ----
# The first list item in each branch is the name of the
# column. While that’s useful for reference, we don’t
# need it as part of the data.
# 
# We can split the lists at index 1 to get only the data
# values.
# 
# We then split up the columns (branches) by their
# respective index. In this cases, branches 4-7 are the
# color counts and RGB values. Branches 1-3 are the
# location and directoni.
panel_2 = Panel(flip)

split_2 = SplitList(List=flip, Index="1")  # -> flatten(ListA), simplify(ListB)
panel_3 = Panel("""4
5
6
7""")
panel_4 = Panel("""1
2
3""")
branch = TreeBranch(Tree=split_2.ListB, Path=panel_3, MaintainPaths=True)
branch_2 = TreeBranch(Tree=split_2.ListB, Path=panel_4, MaintainPaths=True)

panel_5 = Panel(branch_2)

# ----
# Parsing the location data is straightforward. We can
# use the Explode component to get a single data
# stream for the latitude, longitude, and direction.
# Since the direction is in degrees, we need to convert
# it to radians
bang = ExplodeTree(Data=branch_2)  # -> Branch0, Branch1, Branch2
rad = Radians(Degrees=bang.Branch0)
pt = ConstructPoint(XCoordinate=bang.Branch2, YCoordinate=bang.Branch1, ZCoordinate=0)

panel_6 = Panel(branch)

# ----
# Parsing the color counts means converting the string
# representatioin of a Python list into a useful
# Grasshopper list. We do this by rerplacing the
# “[“ and “]” characters, and splitting on the “, character.
# 
# It’s not pretty, but it works since we know the form
# of the data coming in.
# 
# We can Explore the tree into four branches for color
# count, red, green, and blue values. Each branch is
# itself a tree with four branches, where each branch
# is a list with the values for each of the top 10 colors.
panel_7 = Panel("]")
rep = ReplaceText(Text=branch, Find="[", RecursiveReplace=False)
rep_2 = ReplaceText(Text=rep, Find=panel_7, RecursiveReplace=False)
rep_3 = ReplaceText(Text=rep_2, Find=" ", RecursiveReplace=False)
bang_2 = ExplodeTree(Data=rep_3)  # -> Branch0, Branch1, Branch2, Branch3
split_3 = TextSplit(Text=bang_2.Branch0, Separators=",")  # -> simplify(Result)
split_4 = TextSplit(Text=bang_2.Branch1, Separators=",")  # -> simplify(Result)
split_5 = TextSplit(Text=bang_2.Branch2, Separators=",")  # -> simplify(Result)
split_6 = TextSplit(Text=bang_2.Branch3, Separators=",")  # -> simplify(Result)

panel_8 = Panel(split_3)

# ----
# With the frequency of colors, we can create a simple
# visualization as a stacked bar graph, where each
# bar is shaded by the color and where the width
# matches the frequency.
# 
# To do this, we need to leverage Mass Addition,
# which compute the running cumulative total of the
# frequencies. This gives the X positon of each bar.
# 
# We use a multiplication at the top to scale the width.
scale_factor = Slider(0.4, range=0..1)
multiplication = Multiplication(A=split_3, B=scale_factor)
ma = MassAddition(Input=multiplication)  # -> Result, PartialResults
Y = UnitY(Factor=ma.PartialResults)
pt_2 = Point(pt)
move = Move(Geometry=simplify(graft(pt_2)), Motion=Y)  # -> Geometry, Transform
split_7 = SplitList(List=move.Geometry, Index="9")  # -> simplify(ListA), ListB
ins = InsertItems(List=split_7.ListA, Item=simplify(graft(pt_2)), Indices="0", Wrap=True)  # -> simplify(List)

# ----
# Finally, we put it all together! The Mesh and Preview
# components let us apply a color to the Rhino
# preview.
rgb = ColourRGB(Alpha=255, Red=split_4, Green=split_5, Blue=split_6)
rectangle = Rectangle(Plane=ins, XSize=Slider(488, range=0..1000), YSize=multiplication, Radius=0)  # -> Rectangle, Length
rotate = Rotate(Geometry=rectangle.Rectangle, Angle=simplify(graft(rad)), Plane=simplify(graft(pt)))  # -> Geometry, Transform
mesh = Mesh(rotate.Geometry)
preview = CustomPreview(Geometry=mesh, Material=rgb)
