# Grasshopper definition S06_Organizing_presenting_data.ghx (Grasshopper 1.0.7)

path = FilePath("/Users/brianho/Downloads/gridded_tax_lots.csv")
file = ReadFile(File=path, PerLineParse=True)
split = SplitList(List=file, Index="1")  # -> ListA, ListB
split_2 = TextSplit(Text=split.ListA, Separators=";")  # -> simplify(Result)
split_3 = TextSplit(Text=split.ListB, Separators=";")  # -> simplify(Result)
panel = Panel(split_2)
item = ListItem(List=split_3, Index=Slider(95, range=0..100), Wrap=True)  # -> flatten(Item)
item_2 = ListItem(List=split_3, Index=Slider(19, range=0..100), Wrap=True)  # -> flatten(Item)
python = GhPythonScript(guids=item)  # -> out; inputs guids: list
# ---------- python: Python ----------
__author__ = "brianho"

import rhinoscriptsyntax as rs

for guid in guids:
    print(guid)
    rs.SelectObject(guid)
# ---------- end python ----------
area = Area(Geometry=python)  # -> Area, Centroid
vec = VectorXYZ(XComponent=Slider(0, range=-1500..1500), YComponent=Slider(-750, range=-1500..1500), ZComponent=0)  # -> Vector, Length
move = Move(Geometry=area.Centroid, Motion=vec.Vector)  # -> Geometry, Transform
tag = TextTag3D(
    Location=move.Geometry,
    Text=item_2,
    Size=Slider(64, range=0..100),
    Colour=ColourSwatch(SwatchColor=RGB(0, 0, 0)),
    Justification=Slider(5, range=0..10))
