# Grasshopper definition S08 Animations.ghx (Grasshopper 1.0.7)

path = FilePath("/Users/brianho/Downloads/trees.csv")
pipeline = GeometryPipeline(
    GroupByLayer=False,
    GroupByType=False,
    IncludeHidden=True,
    IncludeLocked=True,
    LayerFilter="Trees",
    NameFilter="*",
    SublayerFiltering=True,
    TypeFilter=1)
pipeline_2 = GeometryPipeline(
    GroupByLayer=False,
    GroupByType=False,
    IncludeHidden=True,
    IncludeLocked=True,
    LayerFilter="Buildings",
    NameFilter="*",
    SublayerFiltering=True,
    TypeFilter=1073741848)
file = ReadFile(File=path, PerLineParse=True)
split = TextSplit(Text=file, Separators=";")  # -> simplify(Result)
bnd = Bounds2D(Coordinates=pipeline)
flip = FlipMatrix(Data=split)
dedom2num = DeconstructDomain²(Domain=bnd)  # -> UMin, UMax, VMin, VMax
pdecon = Deconstruct(Point=pipeline)  # -> XComponent, YComponent, ZComponent
split_2 = SplitList(List=flip, Index="1")  # -> simplify(ListA), simplify(ListB)
panel = Panel(split_2.ListA)
number_slider = Slider(34, range=0..42)
sort = SortList(Keys=pdecon.YComponent, ValuesA=pipeline)  # -> Keys, ValuesA
sort_2 = SortList(Keys=pdecon.YComponent, ValuesA=split_2.ListB)  # -> Keys, ValuesA
flip_2 = FlipMatrix(Data=sort_2.ValuesA)
item = ListItem(List=flip_2, Index=Slider(2, range=0..10), Wrap=True)  # -> flatten(Item)
pt = ConstructPoint(XCoordinate=dedom2num.UMin, YCoordinate=dedom2num.VMin, ZCoordinate=0)
item_2 = ListItem(List=sort.ValuesA, Index=number_slider, Wrap=True)
item_3 = ListItem(List=item, Index=number_slider, Wrap=True)
vec2pt = Vector2Pt(PointA=item_2, PointB=pt, Unitize=False)  # -> Vector, Length
move = Move(Geometry=pipeline_2, Motion=vec2pt.Vector)  # -> Geometry, Transform
sph = Sphere(Base=item_2, Radius=expr("x*50", item_3))
preview = CustomPreview(Geometry=move.Geometry, Material=ColourSwatch(SwatchColor=RGB(255, 254, 254)))
move_2 = Move(Geometry=sph, Motion=vec2pt.Vector)  # -> Geometry, Transform
preview_2 = CustomPreview(
    Geometry=move_2.Geometry,
    Material={diffuse=RGB(228, 178, 227), emission=RGB(68, 53, 68), shine=0.5, specular=RGB(255, 254, 254), transparency=0})
