# Grasshopper definition S08_Animating_in_Grasshopper.ghx (Grasshopper 1.0.7)

# ----
# Read CSV file
path = FilePath("/Users/brianho/Developer/git/intro-to-urban-data/example_data/trees.csv")
file = ReadFile(File=path, PerLineParse=True)
split = TextSplit(Text=file, Separators=";")  # -> simplify(Result)
split_2 = SplitTree(Data=split, Masks=flatten("{0}"))  # -> Positive, Negative

# ----
# Select objects based on GUID
number_slider = Slider(17, range=0..100)
item = ListItem(List=split_2.Negative, Index=number_slider, Wrap=True)  # -> flatten(Item)
python = GhPythonScript(guids=item)  # -> out; inputs guids: list
# ---------- python: Python ----------
__author__ = "brianho"

import rhinoscriptsyntax as rs

for guid in guids:
    rs.SelectObject(guid)
    print(guid)
# ---------- end python ----------
geo = Geometry(python)

# ----
# Get one row (branch) from CSV
number_slider_2 = Slider(42, range=0..42)
addition = Addition(A=number_slider_2, B="1")
branch = TreeBranch(Tree=split_2.Negative, Path=addition, MaintainPaths=True)

panel = Panel(split_2.Positive)

# ----
# Get set columns (list items) for branch
number_slider_3 = Slider(2, range=0..100)
number_slider_4 = Slider(13, range=0..100)
item_2 = ListItem(List=branch, Index=number_slider_3, Wrap=True)  # -> flatten(Item)
item_3 = ListItem(List=branch, Index=number_slider_4, Wrap=True)  # -> flatten(Item)
item_4 = ListItem(List=branch, Index=Slider(9, range=0..100), Wrap=True)  # -> flatten(Item)
item_5 = ListItem(List=branch, Index=Slider(4, range=0..100), Wrap=True)  # -> flatten(Item)
panel_2 = Panel(item_2)
panel_3 = Panel(item_3)
panel_4 = Panel(item_4)
panel_5 = Panel(item_5)

# ----
# Create move vector
item_6 = ListItem(List=geo, Index=number_slider_2, Wrap=True)
xy = XYPlane(Origin=Point(0, 0, 0))
vec2pt = Vector2Pt(PointA=item_6, PointB=xy, Unitize=False)  # -> Vector, Length
move = Move(Geometry=item_6, Motion=vec2pt.Vector)  # -> Geometry, Transform

# ----
# Get color based on value
item_7 = ListItem(List=split_2.Negative, Index=number_slider_4, Wrap=True)  # -> simplify(flatten(Item))
bnd = Bounds(Numbers=item_7)
dedomain = DeconstructDomain(Domain=bnd)  # -> Start, End
gradient = Gradient(
    LowerLimit=dedomain.Start,
    UpperLimit=dedomain.End,
    Parameter=panel_3,
    stops=[0.148: RGB(130, 255, 133), 0.85: RGB(0, 58, 220)])

# ----
# Render geometry
number_slider_5 = Slider(5, range=0..100)
number_slider_6 = Slider(300, range=0..1000)
multiplication = Multiplication(A=item_2, B=number_slider_5)
Z = UnitZ(Factor=number_slider_6)
multiplication_2 = Multiplication(A=item_2, B=Slider(15, range=0..100))
pt = Point(move.Geometry)
move_2 = Move(Geometry=pt, Motion=Z)  # -> Geometry, Transform
cir = Circle(Plane=pt, Radius=multiplication)
cyl = Cylinder(Base=pt, Radius=item_2, Length=number_slider_6)
boundary = BoundarySurfaces(Edges=cir)
sph = Sphere(Base=move_2.Geometry, Radius=multiplication_2)
preview = CustomPreview(Geometry=[boundary, sph, cyl], Material=gradient)

# ----
# Render text
pt_2 = Point(move.Geometry)
Z_2 = UnitZ(Factor=expr("-x", Slider(95, range=0..100)))
move_3 = Move(Geometry=pt_2, Motion=Z_2)  # -> Geometry, Transform
tag = TextTag(Location=move_3.Geometry, Text=item_4, Colour=ColourSwatch(SwatchColor=RGB(0, 0, 0)))

pt_3 = Point(move.Geometry)
Z_3 = UnitZ(Factor=expr("-x", Slider(120, range=0..1000)))
move_4 = Move(Geometry=pt_3, Motion=Z_3)  # -> Geometry, Transform
tag_2 = TextTag(Location=move_4.Geometry, Text=item_5, Colour=ColourSwatch(SwatchColor=RGB(0, 0, 0)))

# ----
# Get and move buildings
pipeline = GeometryPipeline(
    GroupByLayer=False,
    GroupByType=False,
    IncludeHidden=True,
    IncludeLocked=True,
    LayerFilter="Buildings",
    NameFilter="*",
    SublayerFiltering=True,
    TypeFilter=1073741848)
move_5 = Move(Geometry=pipeline, Motion=vec2pt.Vector)  # -> Geometry, Transform
col = Colour(ColourSwatch(SwatchColor=RGB(255, 254, 254)))
preview_2 = CustomPreview(Geometry=move_5.Geometry, Material=col)
