# Grasshopper definition S12_Class_Demos_Grasshopper.ghx (Grasshopper 1.0.8)

# ----
# Right click and choose
# “Select one existing file”
# to pick your CSV file
path = FilePath("/Users/brianho/Downloads/bldg_data_for_rhino (2).csv")

# ----
# You don’t need to change this.
# Just remember to create your CSVs
# with the semicolon as the separator
# 
# DataFrame.to_csv(<file_path>, sep=‘;’)
file = ReadFile(File=path, PerLineParse=True)
split = TextSplit(Text=file, Separators=";")  # -> simplify(Result)
split_2 = SplitTree(Data=split, Masks=flatten("{0}"))  # -> Positive, simplify(Negative)
headers = Data(split_2.Positive)
data = Data(split_2.Negative)

# ----
# You can preview all the
# columns in your data with
# a panel component.
panel = Panel(headers)

# ----
# The tenth (index=9) column is the
# heightroof. You can use this to
# extrude the geometry!
panel_2 = Panel("9")
item = ListItem(List=data, Index=panel_2, Wrap=True)  # -> simplify(flatten(Item))
num = Number(item)
Z = UnitZ(Factor=num)

# ----
# The first column is the GUID
# You can use this to select geometry
# in the Rhino file itself
panel_3 = Panel("0")
item_2 = ListItem(List=data, Index=panel_3, Wrap=True)  # -> simplify(flatten(Item))
geo = Geometry(item_2)

extr = Extrude(Base=geo, Direction=Z)
cap = CapHoles(Brep=extr)
